# Grasshopper definition mesh tester 2.gh (Grasshopper 0.9.75)
# plug-ins: GHva3c, LunchBox

mobius = MobiusSurface(
    UDivisions=100,
    VDivisions=100,
    RParameter=[Slider(2, range=0..10), Slider(4, range=0..10)],
    TParameter=0.5,
    Scale=5,
    Domain1=Domain(-3.141592654, 3.141592654),
    Domain2=Domain(-1, 1))
mesh_uv = MeshSurface(Surface=mobius, UCount=Slider(27, range=0..100), VCount=Slider(13, range=0..100), Overhang=True, Equalize=False)
tri = Triangulate(Mesh=mesh_uv)  # -> Mesh, Count
creatematerial = CreateMaterial(Color=ColourSwatch(SwatchColor=RGB(67, 255, 255)))  # -> Material, MaterialNames
va3c_geometry = Va3c_geometry(Mesh=tri.Mesh)
va3c_scene = Va3c_Scene(
    Write=Toggle(False),
    FilePath="C:\Users\bh\Desktop\jsonTester.json",
    MeshGeo=va3c_geometry,
    Materials=creatematerial.Material)
panel = Panel(va3c_scene)
